vi "Token.gvi"   [LabVIEW NXG 5.1.0]
panel controls:
  "stop": bool
  "Token": path
  "Kód kérése": bool
  "file": path
  "file_2": path
  "Kód feltöltése": bool
  "Kód feltöltése_2": f64[]
panel indicators:
  "Hátralévő kódok": i32[]
  "Token kód": f64[]
uses:
  NI::G Core::File IO (General)::Read Delimited Spreadsheet (DBL).gvi
  NI::G Core::File IO (General)::Write Delimited Spreadsheet (DBL).gvi
diagram:
  while {
    event {
      on "Timeout" { }
      on "Kód kérése" Value changed {
        call "Read Delimited Spreadsheet (DBL).gvi"(file=$Token) -> (all rows=w1)
        Delete From Array(inArray=w1) -> (outArray=w2, deleted=w3)
        Array Size(array=w2) -> (size(s)=w4)
        $"Hátralévő kódok" <- w4
        w5 = path "C:\\Users\\Lehopard\\OneDrive - Omega Byte Kft\\token.txt"
        call "Write Delimited Spreadsheet (DBL).gvi"(file=w5, 2D data=w2)
        $"Token kód" <- w3
      }
      on "Kód feltöltése" Value changed {
        call "Read Delimited Spreadsheet (DBL).gvi"(file=$file) -> (all rows=w6)
        Insert Into Array(inArray=w6, new=$"Kód feltöltése_2") -> w7
        call "Write Delimited Spreadsheet (DBL).gvi"(file=$file_2, 2D data=w7)
      }
    }
    stop if $stop
  }
